# Grasshopper definition Server.gh (Grasshopper 1.0.8)
# plug-ins: RhinoCodePluginGH

connect = BooleanToggle(True)
brep = Brep(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)
mesh = Mesh(brep)
c_script = CSharpScript(connect=connect, ipAdress="127.0.0.1", geometry=mesh)  # -> out, a; inputs connect: Boolean, ipAdress: String, geometry: list of Mesh
# ---------- c_script: C# ----------
// Grasshopper Script Instance
#region Usings
using System;
using System.Linq;
using System.Collections;
using System.Collections.Generic;
using System.Drawing;
using System.Threading;

using Rhino;
using Rhino.Geometry;

using Grasshopper;
using Grasshopper.Kernel;
using Grasshopper.Kernel.Data;
using Grasshopper.Kernel.Types;

using System;
using System.Collections.Generic;
using System.Net;
using System.Net.Sockets;
using System.Threading;
using System.Threading.Tasks;

#r "C:\Git\GeometryStreamer\2_Client\RhinoGH\bin\Debug\net4.8\Core.dll"
using GeoStreamer;
#r "C:\Git\GeometryStreamer\2_Client\RhinoGH\bin\Debug\net4.8\RhinoGH.gha"
using GeoGrasshopper;

#r "nuget: KGySoft.CoreLibraries, 8.1.0"
#endregion

public class Script_Instance : GH_ScriptInstance
{
    RhinoClient client;
    readonly List<string> debugLog = new List<string>();
    Timer timer;
    double timeIntervalInSeconds = 0.1;
    static Tuple<StreamSettings, List<object>> actualValues = null;

    private void RunScript(
	bool connect,
	string ipAdress,
	List<Mesh> geometry,
	ref object a)
    {
       bool isConnected = ConnectClient(connect, ipAdress);

        if (timer == null)
            timer = new Timer(SendLoop, "Some state", TimeSpan.FromSeconds(timeIntervalInSeconds), TimeSpan.FromSeconds(timeIntervalInSeconds));

        if (client == null || !isConnected) 
            return;

        List<object> objs = new List<object>();

        foreach (var msh in geometry)
        {
            objs.Add((object)msh);
        }


        SendGeometry(objs);
    }

    private void SendGeometry(List<object> geometry)
    {
        StreamSettings settings = new(System.Drawing.Color.AliceBlue);

        actualValues = new Tuple<StreamSettings, List<object>>(settings, geometry);   
    }

    private bool ConnectClient(bool connect, string ipAdress)
    {
        int port = Utils.GetTestPort();
        bool isConnected = false;

        if (connect)
        {
            if (client == null)
            {
                client = RhinoClient.Initialize(ipAdress, port, "RhinoClient", ThreadingType.Task, 20, (int)ClientType.Default);
            }

            if (!client.IsConnected)
            {
            //  client = RhinoClient.Initialize(ipAdress, port, "RhinoClient", ThreadingType.Thread, 20, (int)ClientType.Default);
            // client.Message += OnMessage;
                client.Connect();          
            }

            isConnected = client.IsConnected;
        }
        else
        {
            if (client != null)
                client.Disconnect();
    
            //client = null;
            isConnected = false;
            debugLog.Add("Try to Disconnect...");
        }

        return isConnected;
    }

    private  void SendLoop(object state)
    {
        StreamSettings settings;
        List<object> geometry;

        if (actualValues == null)
            return;

        lock (actualValues)
        {
            settings = actualValues.Item1;
            geometry = actualValues.Item2;

            actualValues = null;
        }

        int geoCount = geometry.Count;
        int curveCount = 0;
        int meshCount = 0;
        int textCount = 0;

        for (int id = 0; id < geoCount; id++)
        {
            var geo = geometry[id];
            if (geo == null)
                continue;

            if (geo is GH_Curve)
                curveCount++;
            else if (geo is GH_Mesh)
                meshCount++;
        //  else if (geo is GH_StreamText)
        //      textCount++;
        }

        Send.GeometryInfo(curveCount, meshCount, textCount, client);

        int meshNr = 0;
        int curveNr = 0;
        int textNr = 0;

        for (int id = 0; id < geoCount; id++)
        {
            var geo = geometry[id];
            if (geo == null)
                continue;

            if (geo is Curve)
            {
                Send.Curve(id, curveNr,(Curve)geo, settings, client);
                curveNr++;
            }

            else if (geo is Mesh)
            {
                Send.Mesh(id, meshNr,(Mesh)geo, settings, client);
                meshNr++;
            }

            // else if (geo is GH_StreamText)
            // {

            //     StreamText bla = ((GH_StreamText)geo).Value;

            // var df = bla.Text; 

            //     Send.Text(id, textNr, ((GH_StreamText)geo).Value, settings, client);
            //     textNr++;
            // }

            else
            {          
                throw new Exception("TYPE IS NOT ALLOWED" + ((GH_ObjectWrapper)geo).Value.GetType());
            }
        }
    }
}
# ---------- end c_script ----------
c_script_2 = CSharpScript()  # -> out, location, location2
# ---------- c_script_2: C# ----------
// Grasshopper Script Instance
#region Usings
using System;
using System.Linq;
using System.Collections;
using System.Collections.Generic;
using System.Drawing;
using System.Threading;

using Rhino;
using Rhino.Geometry;

using Grasshopper;
using Grasshopper.Kernel;
using Grasshopper.Kernel.Data;
using Grasshopper.Kernel.Types;

#r "C:\Git\GeometryStreamer\2_Client\RhinoGH\bin\Debug\net7.0-windows\Core.dll"
using GeoStreamer;
#r "C:\Git\GeometryStreamer\2_Client\RhinoGH\bin\Debug\net7.0-windows\RhinoGH.gha"
using GeoGrasshopper;
#endregion

public class Script_Instance : GH_ScriptInstance
{

    private void RunScript(ref object location, ref object location2)
    {
        location = GeoStreamer.Utils.GetAssemblyLocation();
        location2= RhinoClient.GetAssemblyLocation();
    }


}
# ---------- end c_script_2 ----------
panel = Panel(c_script_2.location)
panel_2 = Panel(c_script_2.location2)
