# Grasshopper definition geostreamer.gh (Grasshopper 1.0.7)

ip_adress = Panel(" 127.0.0.1")
c_script = CSharpScript(
    ipAdress=ip_adress,
    connect=Toggle(False),
    Reference="C:\Users\N C Delille\Documents\Git\GeometryStreamer\RhinoGeoStreamer\GeoStreamer_Net45.dll")  # -> out, A; inputs ipAdress: String, connect: Boolean
# ---------- c_script: C# usings ----------
using GeoStreamer;
# ---------- c_script: C# ----------
    //    Console.WriteLine("############");
    //    Console.WriteLine("Client 1");
    //    Console.WriteLine("############");
    if (!connect)
    {
      if (EventClient.Instance != null)
      {
        EventClient.Instance.Disconnect();
      }

      return;
    }

    client = EventClient.Initialize(ipAdress, 12345, "RhinoClient", ThreadingType.Task, ClientType.Default);
    client.Message += OnMessage;
    client.Connect();

    client.SendingRandomData(1000);

    for (int i = 0; i < 1000; i++)
    {
      BroadCastMsg bc = new BroadCastMsg() { broadcastMsg = " Hey hier ist client Rhinooo " };

      client.Send(bc);
    }

    A = messages;
# ---------- c_script: C# additional code ----------
  public static List<string> messages = new   List<string>();

  public static EventClient client;

  private static void OnMessage(object sender, MessageArgs e)
  {
    messages.Add(e.Message);
  }
# ---------- end c_script ----------
panel = Panel(c_script.out)
panel_2 = Panel(c_script.A)
