# Grasshopper definition server.gh (Grasshopper 1.0.7)

connect = BooleanToggle(True)
connect_2 = BooleanToggle(True)
server = CSharpScript(
    connect=connect,
    Reference=["C:\Git\GeometryStreamer\GeoServer\PipeCore\bin\Debug\net4.8\PipeCore.dll", "C:\Git\GeometryStreamer\GeoServer\PipeCore\bin\Debug\net4.8\Newtonsoft.Json.dll"])  # -> out, A; inputs connect: Boolean
# ---------- server: C# usings ----------
using PipeCore;
# ---------- server: C# ----------
    component = this.Component;

    // Hack Buggy
    PipeConnection_Server.OnMessage -= OnMessage;
    PipeConnection_Server.OnMessage += OnMessage;

    if (connect)
    {
      if (PipeConnection_Server.Instance == null)
      {
        messages.Clear();
      }

      PipeConnection_Server.Initialize();
    }
    else
    {
      if (PipeConnection_Server.Instance != null)
        PipeConnection_Server.Instance.DestroySelf();
    }

    A = messages;
# ---------- server: C# additional code ----------
  static IGH_Component component;

  static void OnPipeCommandReceived(object sender, PipeCommand e)
  {
    messages.Add(e.command);
    component.ExpireSolution(true);
  }

  static void OnMessage(object sender, string e)
  {
    messages.Add(e);
    component.ExpireSolution(true);

  }

  static List<string> messages = new   List<string>();
# ---------- end server ----------
client = CSharpScript(connect=connect_2, Reference="C:\Git\GeometryStreamer\GeoServer\PipeCore\bin\Debug\net4.8\PipeCore.dll")  # -> out, A; inputs connect: Boolean
# ---------- client: C# ----------
    if (connect)
    {
      PipeCore.PipeConnection_Client.Initialize();
    }else
    {

    }
# ---------- end client ----------
panel = Panel(server.out)
panel_2 = Panel(server.A)
