# Grasshopper definition SubTriangulation.gh (Grasshopper 1.0.7)

width = Slider(7, range=2..10)
point = Point([<point referenced from the Rhino model> x4])
vector = Vector(point)
subtriangle = CSharpScript(pts=point, size=width)  # -> out, A; inputs pts: list of Vector3d, size: Int32
# ---------- subtriangle: C# ----------
    Vector3d a = pts[0];
    Vector3d b = pts[1];
    Vector3d c = pts[2];
    Vector3d d = pts[3];

    Vector3d ab = Vector3d.Subtract(b, a);
    Vector3d ad = Vector3d.Subtract(d, a);
    Vector3d cd = Vector3d.Subtract(d, c);
    Vector3d cb = Vector3d.Subtract(b, c);

    double sFactor = 1.00 / (size - 1);

    Point3d[] testPts = new Point3d[(size ) *(size)];

    for (int h = 0; h < size ; h++)
    {
      for (int w = 0; w < size ; w++)
      {
        Point3d pt;

        if (w < size - h)
        {
          pt = new Point3d(a) + (ab * w + ad * h) * sFactor;
        }
        else
        {
          var s = size - 1;
          pt = new Point3d(c) + (cd * (s - w) + cb * (s - h)) * sFactor;
        }

        testPts[h * size + w] = pt;
      }
    }

    A = testPts;
# ---------- end subtriangle ----------
panel = Panel(vector)
list_item = ListItem(List=point, Index=Slider(0, range=0..10), Wrap=True)
panel_2 = Panel(subtriangle.A)
sphere = Sphere(Base=subtriangle.A, Radius=1)
panel_3 = Panel(subtriangle.out)
