# Grasshopper definition FiberwindingExample.gh (Grasshopper 1.0.7)
# plug-ins: GeoGrasshopper

number_slider = Slider(100, range=1..100)
curve = Curve(<curve referenced from the Rhino model>)
curve_2 = Curve(<curve referenced from the Rhino model>)
number_slider_2 = Slider(78, range=0..100)
divide_curve = DivideCurve(Curve=curve, Count=10, Kinks=False)  # -> Points, Tangents, Parameters
divide_curve_2 = DivideCurve(Curve=curve_2, Count=10, Kinks=False)  # -> Points, Tangents, Parameters
weave = Weave(Pattern=[0, 1], Stream0=divide_curve.Points, Stream1=divide_curve_2.Points, NullGaps=False)
fiberwindingcomponent = FiberwindingComponent(
    WeavingPoints=weave,
    Index=Slider(7, range=0..10),
    MarkerSize=Slider(100, range=0..100),
    ArrowSize=Slider(31, range=0..100))  # -> StreamGeometry, StreamSettings
panel = Panel(" RobotPath")
brep = Brep([<brep referenced from the Rhino model> x23])

series = Series(Start=0, Step=expr("1/x", number_slider), Count=expr("x+1", number_slider))
curve_3 = Curve(<curve referenced from the Rhino model>)
curve_4 = Curve(<curve referenced from the Rhino model>)
tween_curve = TweenCurve(CurveA=curve_3, CurveB=curve_4, Factor=series, BlendType=0)
mesh_brep = MeshBrep(
    Brep=brep,
    Settings={GridMaxCount=1, GridMinCount=1, JaggedSeams=False, MaxEdgeLength=0, MinEdgeLength=100, MinTolerance=0, Refine=True, RefineAngle=0, RelativeTolerance=1, SimplePlanes=True, Tolerance=100})  # -> flatten(Mesh)

curve_5 = ColourSwatch(SwatchColor=RGB(102, 184, 61))
unit_x = UnitX(Factor=Slider(321, range=0..1000))
create_material = CreateMaterial(Diffuse=curve_5, Specular=curve_5, Emission=RGB(0, 0, 0), Transparency=Slider(0.2, range=0..1), Shine=0)
geometrystreamer = GeometryStreamer(
    IpAdress="192.168.0.52",
    Connect=False,
    UpdateDebug=False,
    Geometry=fiberwindingcomponent.StreamGeometry,
    Settings=fiberwindingcomponent.StreamSettings)
streampreviewcomponent = StreamPreviewComponent(Geometry=fiberwindingcomponent.StreamGeometry, Settings=fiberwindingcomponent.StreamSettings)
panel_2 = Panel(mesh_brep)
streamsettings = StreamSettings(Material=create_material, CurveDivision=Slider(10, range=0..100), CurveWidth=Slider(0.001, range=0..0.1))
connect = BooleanToggle(False)
update = Button()
relay = Relay()
geometrystreamer_2 = GeometryStreamer(IpAdress="192.168.178.69", Connect=connect, UpdateDebug=update, Geometry=relay, Settings=streamsettings)
streampreviewcomponent_2 = StreamPreviewComponent(Geometry=relay, Settings=streamsettings)
