# Grasshopper definition FiberwindingExample_sticks.gh (Grasshopper 1.0.7)
# plug-ins: Robots, GeoGrasshopper

# ----
# WeavingPattern Vertical
number_slider = Slider(0.5, range=0..1)
crv = Curve(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)
crv_2 = Curve(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)
C = ColourSwatch(SwatchColor=RGB(59, 235, 185))
loft = Loft(Curves=[crv, crv_2], Options={Adjust=False, Closed=False, LoftEnds=0, LoftSimp=0, LoftType=0, Rebuild=10, Refit=0.01})
material = CreateMaterial(Diffuse=C, Specular=RGB(255, 255, 255), Emission=RGB(0, 0, 0), Transparency=number_slider, Shine=0)
preview = CustomPreview(Geometry=loft, Material=material)
sdivide = DivideSurface(Surface=loft, UCount=1, VCount=Slider(40, range=0..100))  # -> simplify(Points), Normals, Parameters
pl = PlaneNormal(Origin=sdivide.Points, ZAxis=expr("-x", sdivide.Normals))
panel = Panel("""1
1
0
0""")
panel_2 = Panel("""0
1""")
bang = ExplodeTree(Data=pl)  # -> Branch0, Branch1
weave = Weave(Pattern=panel_2, Stream0=bang.Branch0, Stream1=bang.Branch1, NullGaps=False)

number_slider_2 = Slider(90, range=0..100)
crv_3 = Curve(<curve referenced from the Rhino model>)
rev = ReverseList(List=bang.Branch0)
pln = Plane(weave)
pt = Point(Point(-435.171673, 964.9798657, 335.6973495))
pt_2 = Point(Point(809.5136859, 734.0761633, 0))

# ----
# Tool Definition
# n
n = Slider(115, range=0..130)
endeffektor = Mesh(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)
c_gettcp = CSharpScript(mesh=endeffektor, n=n)  # -> TCP, MeshNozzle; inputs mesh: Mesh, n: Double
# ---------- c_gettcp: C# ----------
    BoundingBox bBox = mesh.GetBoundingBox(false);

    double height = 164 + n;

    Cylinder c = new Cylinder(new Circle(new Point3d(0, 0, 93.25), 5.25), height);
    Mesh mC = Mesh.CreateFromCylinder(c, 1, 8);

    mC.Append(mesh);

    TCP = new Plane(new Point3d(0, 0, 257.25 + n), Vector3d.ZAxis);
    MeshNozzle = mC;
# ---------- end c_gettcp ----------
tool = CreateTool(ExtruderLance="windingTool", TCP=c_gettcp.TCP, Weight=0, Mesh=c_gettcp.MeshNozzle)  # -> Tool, TCP

# ----
# Table
arbeitstisch = Mesh([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])
C_2 = ColourSwatch(SwatchColor=RGB(176, 176, 176))
preview_2 = CustomPreview(Geometry=arbeitstisch, Material=C_2)

# ----
# Robot System
value_list = ValueList({"UR 10 Tisch": 0, "UR 5 Tisch": 1, "UR 5 Tisch außen": 2}, selected="UR 10 Tisch")
c_robotpos = CSharpScript(UR=value_list, TooltipTextOverride="Author: Leon Brohmann")  # -> Name, BasePlane, IpAddress; inputs UR: Int32
# ---------- c_robotpos: C# ----------
    string name;
    Point3d pos;
    string ipAddress;

    switch (UR)
    {
      default:
        name = "ITE-UR10";
        ipAddress = "192.168.1.201";
        pos = Point3d.Origin;
        break;

      case 1:
        name = "ITE-UR5";
        ipAddress = "192.168.1.202";
        pos = new Point3d(0, 1110, 0);
        break;

      case 2:
        name = "ITE-UR5";
        ipAddress = "192.168.1.202";
        pos = new Point3d(0, 1700, 0);
        break;
    }

    Name = name;
    BasePlane = new Plane(pos, Vector3d.ZAxis);
    IpAddress = ipAddress;
# ---------- end c_robotpos ----------
load_robot = LoadRobotSystem(Name=c_robotpos.Name, Base=c_robotpos.BasePlane)

# ----
# Speed
speed = Slider(8313, range=300..10000)

brep = Brep(<brep referenced from the Rhino model>)
number_slider_3 = Slider(0.6, range=0..1)
mesh = MeshBrep(Settings={GridMaxCount=0, GridMinCount=16, JaggedSeams=False, MaxEdgeLength=0, MinEdgeLength=6, MinTolerance=0, Refine=True, RefineAngle=0, RelativeTolerance=0.65, SimplePlanes=True, Tolerance=0})
mesh_2 = Mesh([<mesh referenced from the Rhino model> x7])
geostream = GeometryStreamer(IpAdress="192.168.178.38", Connect=Toggle(False), UpdateDebug=False, Geometry=mesh_2)

# ----
# WeavingPattern
number_slider_4 = Slider(6, range=0..100)
crv_4 = Curve(<curve referenced from the Rhino model>)
crv_5 = Curve(<curve referenced from the Rhino model>)
divide = DivideCurve(Curve=crv_4, Count=number_slider_4, Kinks=False)  # -> Points, Tangents, Parameters
divide_2 = DivideCurve(Curve=crv_5, Count=number_slider_4, Kinks=False)  # -> Points, Tangents, Parameters
panel_3 = Panel("""0
0
1
1""")
panel_4 = Panel("""0
1""")

pframes = PerpFrames(Curve=crv_5, Count=number_slider_4, Align=True)  # -> Frames, Parameters
pframes_2 = PerpFrames(Curve=crv_4, Count=number_slider_4, Align=True)  # -> Frames, Parameters
deplane = DeconstructPlane(Plane=pframes_2.Frames)  # -> Origin, XAxis, YAxis, ZAxis
deplane_2 = DeconstructPlane(Plane=pframes.Frames)  # -> Origin, XAxis, YAxis, ZAxis
rot3d = Rotate3D(Geometry=pframes_2.Frames, Angle=degrees(number_slider_2), Center=pframes_2.Frames, Axis=deplane.XAxis)  # -> Geometry, Transform
rot3d_2 = Rotate3D(Geometry=pframes.Frames, Angle=degrees(number_slider_2), Center=pframes.Frames, Axis=deplane_2.XAxis)  # -> Geometry, Transform
divide_3 = DivideCurve(Curve=crv_3, Count=number_slider_4, Kinks=False)  # -> Points, Tangents, Parameters

weave_2 = Weave(Pattern=panel_3, Stream0=rot3d.Geometry, Stream1=rot3d_2.Geometry, NullGaps=False)

pflip = FlipPlane(Plane=weave_2, ReverseX=False, ReverseY=False, SwapAxes=True)

pln_2 = Plane(pflip)

pln_3 = Plane(pln_2)

# ----
# Fiber Winder
alignaxis = ValueList({"None": 0, "X": 1, "Y": 2}, selected="Y")
index = Slider(91, range=0..100)
pinsize = Slider(48, range=0..100)
toolrotation = Slider(25, range=-180..180)
fwinder = FiberWinder(
    WeavingPlanes=pln_3,
    StartPoint=pt,
    EndPoint=pt_2,
    Index=index,
    PinSize=pinsize,
    FiberMulti=0,
    BendingMulti=Slider(0, range=0..1),
    BendingDistance=Slider(0.5, range=0..1),
    MarkerSize=Slider(25, range=0..1000),
    AlignAxis=alignaxis,
    ToolRotation=toolrotation)  # -> StreamGeometry, StreamSettings, RobotPlanes

# ----
# Target
value_list_2 = ValueList({"Joint", "Linear"}, selected="Linear")
list = FlagFields({"Shoulder": 1, "Elbow": 2, "Wrist": 4}, selected=[])
target = CreateTarget(Plane=fwinder.RobotPlanes, RobConf=list, Motion=value_list_2, Tool=tool.Tool, Speed=speed, IsCartesian=True)

# ----
# Preview
program = CreateProgram(Name="DefaultProgram", RobotSystem=load_robot, Targets1=target, StepSize=1)  # -> Program, Code, Duration, Warnings, Errors, Arrays
knob = ControlKnob(Decimals=3, Limit=True, Maximum=1, Minimum=0, Range=1, Value=0.258)
sim = ProgramSimulation(Program=program.Program, Time=knob, Normalized=True)  # -> SystemMeshes, JointRotations, Plane, Index, Time, Program, Errors
C_3 = ColourSwatch(SwatchColor=RGB(227, 227, 227))
preview_3 = CustomPreview(Geometry=sim.SystemMeshes, Material=C_3)

geo = Geometry(sim.SystemMeshes)

# ----
# UR Control
play = Button()
remoteur = RemoteUR(Program=program.Program, IP=c_robotpos.IpAddress, Upload=False, Play=play, Pause=False)

# ----
# Path Preview
number_slider_5 = Slider(2, range=0..10)
pline = PolyLine(Vertices=fwinder.RobotPlanes, Closed=False)  # -> reparameterize(Polyline)
c_preview = CSharpScript(index=sim.Index, simPlanes=sim.Plane, pLine=pline, width=number_slider_5)  # inputs index: Int32, simPlanes: list of Plane, pLine: Curve, width: Int32
# ---------- c_preview: C# ----------
    preview = null;
    _width = width;

    Point3d testPoint = simPlanes[7].Origin;

    double t = 0;
    pLine.ClosestPoint(testPoint, out t);

    if (t == 0)
      return;

    if (t == 1)
    {
      preview = pLine;
      return;
    }

    Curve[] crvs = pLine.Split(t);

    if (crvs == null || crvs.Length < 1)
      return;

    preview = crvs[0];
# ---------- c_preview: C# additional code ----------
  Curve preview;
  int _width;

  public override void DrawViewportMeshes(IGH_PreviewArgs args)
  {
    if (preview != null)
      args.Display.DrawCurve(preview, System.Drawing.Color.Black, _width);

  }
# ---------- end c_preview ----------

relay = Relay([pline, geo])
