# Grasshopper definition FiberwindingHololens.gh (Grasshopper 1.0.7)
# plug-ins: GeoGrasshopper

# ----
# WeavingPattern Vertical
number_slider = Slider(0.5, range=0..1)
curve = Curve(<curve referenced from the Rhino model>)
curve_2 = Curve(<curve referenced from the Rhino model>)
C = ColourSwatch(SwatchColor=RGB(214, 59, 235))
create_material = CreateMaterial(Diffuse=C, Specular=RGB(255, 255, 255), Emission=RGB(0, 0, 0), Transparency=number_slider, Shine=0)
loft = Loft(
    Curves=[curve, curve_2],
    Options={Adjust=False, Closed=False, LoftEnds=0, LoftSimp=0, LoftType=0, Rebuild=10, Refit=0.01})
custom_preview = CustomPreview(Geometry=loft, Material=create_material)
divide_surface = DivideSurface(Surface=loft, UCount=1, VCount=Slider(40, range=0..1000))  # -> simplify(Points), Normals, Parameters
plane_normal = PlaneNormal(Origin=divide_surface.Points, ZAxis=expr("-x", divide_surface.Normals))
panel = Panel("""1
1
0
0""")
panel_2 = Panel("""0
1""")
explode_tree = ExplodeTree(Data=plane_normal)  # -> Branch0, Branch1
weave = Weave(Pattern=panel, Stream0=explode_tree.Branch0, Stream1=explode_tree.Branch1, NullGaps=False)

# ----
# WeavingPattern
number_slider_2 = Slider(40, range=0..100)
curve_3 = Curve(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)
curve_4 = Curve(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)
divide_curve = DivideCurve(Curve=curve_3, Count=number_slider_2, Kinks=False)  # -> Points, Tangents, Parameters
divide_curve_2 = DivideCurve(Curve=curve_4, Count=number_slider_2, Kinks=False)  # -> Points, Tangents, Parameters
panel_3 = Panel("""1
0
0
1""")
weave_2 = Weave(Pattern=panel_3, Stream0=divide_curve.Points, Stream1=divide_curve_2.Points, NullGaps=False)
plane = Plane(weave_2)

# ----
# StartEnd
point = Point(Point(464.6719221, -720.7696851, 335.6973495))
point_2 = Point(Point(683.7194242, 569.4931377, 0))

plane_2 = Plane(plane)
plane_3 = Plane(weave)

# ----
# Fiber Winder
index = Slider(19, range=0..200)
alignaxis = ValueList({"None": 0, "X": 1, "Y": 2}, selected="Y")
pinsize = Slider(10, range=0..100)
toolrotation = Slider(25, range=-180..180)
c_script = CSharpScript(valueList=plane_3, slider=index)  # -> out, Slider; inputs valueList: list of Plane, slider: Int32
# ---------- c_script: C# ----------
    int max = valueList.Count - 1;

    if (slider > max)
      slider = max;

    Slider = slider;
# ---------- end c_script ----------
s_gate = StreamGate(GateId=0, Number=c_script.Slider)
fiber_winder = FiberWinder(
    WeavingPlanes=plane_3,
    StartPoint=point,
    EndPoint=point_2,
    Index=s_gate,
    PinSize=pinsize,
    FiberMulti=0,
    BendingMulti=Slider(0, range=0..1),
    BendingDistance=Slider(0.5, range=0..1),
    MarkerSize=Slider(25, range=0..1000),
    AlignAxis=alignaxis,
    ToolRotation=toolrotation)  # -> StreamGeometry, StreamSettings, RobotPlanes

# ----
# Table
arbeitstisch = Mesh([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])
C_2 = ColourSwatch(SwatchColor=RGB(176, 176, 176))
custom_preview_2 = CustomPreview(Geometry=arbeitstisch, Material=C_2)

# ----
# Geometry Streamer
boolean_toggle = BooleanToggle(True)
geostream = GeometryStreamer(
    IpAdress="192.168.0.69",
    Connect=boolean_toggle,
    UpdateDebug=False,
    Geometry=fiber_winder.StreamGeometry,
    Settings=fiber_winder.StreamSettings)
