# Grasshopper definition GeostreamerForDebug.gh (Grasshopper 1.0.7)
# plug-ins: GeoGrasshopper

number_slider = Slider(100, range=1..100)
number_slider_2 = Slider(78, range=0..100)
brep = Brep([<brep referenced from the Rhino model> x23])

series = Series(Start=0, Step=expr("1/x", number_slider), Count=expr("x+1", number_slider))
crv = Curve(<curve referenced from the Rhino model>)
crv_2 = Curve(<curve referenced from the Rhino model>)
tweencrv = TweenCurve(CurveA=crv, CurveB=crv_2, Factor=series, BlendType=0)
mesh = MeshBrep(
    Brep=brep,
    Settings={GridMaxCount=1, GridMinCount=1, JaggedSeams=False, MaxEdgeLength=0, MinEdgeLength=100, MinTolerance=0, Refine=True, RefineAngle=0, RelativeTolerance=1, SimplePlanes=True, Tolerance=100})  # -> flatten(Mesh)

curve = ColourSwatch(SwatchColor=RGB(102, 184, 61))
X = UnitX(Factor=Slider(321, range=0..1000))
material = CreateMaterial(Diffuse=curve, Specular=curve, Emission=RGB(0, 0, 0), Transparency=Slider(0.2, range=0..1), Shine=0)
panel = Panel(mesh)
gs_settings = StreamSettings(Material=material, CurveDivision=Slider(10, range=0..100), CurveWidth=Slider(0.001, range=0..0.1))
connect = BooleanToggle(False)
update = Button()
relay = Relay()
streampreview = StreamPreviewComponent(Geometry=relay, Settings=gs_settings)
geostream = GeometryStreamer(IpAdress="192.168.178.69", Connect=connect, UpdateDebug=update, Geometry=relay, Settings=gs_settings)
