# Grasshopper definition geostreamer2.gh (Grasshopper 1.0.7)
# plug-ins: GeoGrasshopper

number_slider = Slider(40, range=0..2000)
series = Series(Start=0, Step=expr("1/x", number_slider), Count=expr("x+1", number_slider))
crv = Curve(<curve referenced from the Rhino model>)
crv_2 = Curve(<curve referenced from the Rhino model>)
tweencrv = TweenCurve(CurveA=crv, CurveB=crv_2, Factor=series, BlendType=0)
pipe = Pipe(Curve=tweencrv, Radius=Slider(10, range=1..100), Caps=0)
mesh = MeshBrep(
    Brep=pipe,
    Settings={GridMaxCount=0, GridMinCount=16, JaggedSeams=False, MaxEdgeLength=0, MinEdgeLength=0.0001, MinTolerance=0, Refine=True, RefineAngle=0, RelativeTolerance=0.65, SimplePlanes=True, Tolerance=0})  # -> flatten(Mesh)

curve = ColourSwatch(SwatchColor=RGB(51, 167, 255))
mesh_2 = ColourSwatch(SwatchColor=RGB(0, 0, 0))
relay = Relay([Slider(6, range=0..10), Slider(2, range=0..10)])
material = CreateMaterial(Diffuse=mesh_2, Specular=mesh_2, Emission=ColourSwatch(SwatchColor=RGB(0, 255, 132)), Transparency=0, Shine=0)
material_2 = CreateMaterial(Diffuse=curve, Specular=curve, Emission=RGB(0, 0, 0), Transparency=Slider(0.5, range=0..1), Shine=0)
panel = Panel("""0
1""")
relay_2 = Relay([material, material_2])
repeat = RepeatData(Data=relay, Length=expr("x+1", number_slider))
repeat_2 = RepeatData(Data=panel, Length=expr("x+1", number_slider))
gs_settings = StreamSettings(Material=relay_2, ObjectMaterialIds=repeat_2, CurveDivision=Slider(60, range=0..100), CurveWidth=repeat)
connect = BooleanToggle(False)
update = Button()
panel_2 = Panel(" 127.0.0.1")
streampreview = StreamPreviewComponent(Geometry=mesh, Settings=gs_settings)
geostream = GeometryStreamer(IpAdress="127.0.0.1", Connect=connect, UpdateDebug=update, Geometry=mesh, Settings=gs_settings)  # disabled
