# Grasshopper definition geostreamer§_AECTECH.gh (Grasshopper 1.0.7)
# plug-ins: GeoGrasshopper

curve = ColourSwatch(SwatchColor=RGB(101, 155, 199))
material = CreateMaterial(Diffuse=curve, Specular=curve, Emission=RGB(0, 0, 0), Transparency=Slider(0.2, range=0..1), Shine=0)
crv = Curve(<curve referenced from the Rhino model>)
crv_2 = Curve(<curve referenced from the Rhino model>)
gs_settings = StreamSettings(Material=material, CurveDivision=Slider(4, range=0..100), CurveWidth=Slider(0.09, range=0..0.1))
loft = Loft(Curves=[crv, crv_2], Options={Adjust=False, Closed=False, LoftEnds=0, LoftSimp=0, LoftType=0, Rebuild=10, Refit=0.01})
mesh = MeshBrep(
    Brep=loft,
    Settings={GridMaxCount=0, GridMinCount=16, JaggedSeams=False, MaxEdgeLength=0, MinEdgeLength=0.0001, MinTolerance=0, Refine=True, RefineAngle=0, RelativeTolerance=0.65, SimplePlanes=True, Tolerance=0})  # -> flatten(Mesh)
connect = BooleanToggle(False)
update = Button()
streampreview = StreamPreviewComponent(Geometry=mesh, Settings=gs_settings)
geostream = GeometryStreamer(IpAdress="127.0.0.1", Connect=connect, UpdateDebug=update, Geometry=mesh, Settings=gs_settings)
