# Grasshopper definition FiberwindingExample.gh (Grasshopper 1.0.7)
# plug-ins: Robots, GeoGrasshopper

number_slider = Slider(10, range=0..100)
curve = Curve(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)
curve_2 = Curve(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)
divide_curve = DivideCurve(Curve=curve, Count=number_slider, Kinks=False)  # -> Points, Tangents, Parameters
divide_curve_2 = DivideCurve(Curve=curve_2, Count=number_slider, Kinks=False)  # -> Points, Tangents, Parameters
panel = Panel("""0
0
1
1""")
weave = Weave(Pattern=panel, Stream0=divide_curve.Points, Stream1=divide_curve_2.Points, NullGaps=False)
index = Slider(10, range=0..100)
pinsize = Slider(58, range=0..100)
plane = Plane(weave)
point = Point(Point(-294.6346774, 392.1578581, 0))
point_2 = Point(Point(-616.9600397, -560.0576841, 0))
fiber_winder = FiberWinder(
    WeavingPlanes=plane,
    StartPoint=point,
    EndPoint=point_2,
    Index=index,
    PinSize=pinsize,
    FiberMulti=0,
    BendingMulti=Slider(0.09, range=0..1),
    BendingDistance=Slider(1, range=0..1),
    MarkerSize=Slider(32, range=0..1000))  # -> StreamGeometry, StreamSettings, RobotPlanes
xy_plane = XYPlane(Origin=fiber_winder.RobotPlanes)
value_list = ValueList({"UR 10 Tisch": 0, "UR 5 Tisch": 1, "UR 5 Tisch außen": 2}, selected="UR 10 Tisch")

# ----
# Table
arbeitstisch = Mesh([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])
C = ColourSwatch(SwatchColor=RGB(176, 176, 176))
custom_preview = CustomPreview(Geometry=arbeitstisch, Material=C)

# ----
# Robot System
c_robotpos = CSharpScript(UR=value_list, TooltipTextOverride="Author: Leon Brohmann")  # -> out, Name, BasePlane, IpAddress; inputs UR: Int32
# ---------- c_robotpos: C# ----------
    string name;
    Point3d pos;
    string ipAddress;

    switch (UR)
    {
      default:
        name = "ITE-UR10";
        ipAddress = "192.168.1.201";
        pos = Point3d.Origin;
        break;

      case 1:
        name = "ITE-UR5";
        ipAddress = "192.168.1.202";
        pos = new Point3d(0, 1110, 0);
        break;

      case 2:
        name = "ITE-UR5";
        ipAddress = "192.168.1.202";
        pos = new Point3d(0, 1700, 0);
        break;
    }

    Name = name;
    BasePlane = new Plane(pos, Vector3d.ZAxis);
    IpAddress = ipAddress;
# ---------- end c_robotpos ----------
flip_plane = FlipPlane(Plane=xy_plane, ReverseX=False, ReverseY=False, SwapAxes=True)
load_robot_system = LoadRobotSystem(Name=c_robotpos.Name, Base=c_robotpos.BasePlane)
polyline = PolyLine(Vertices=flip_plane, Closed=False)  # disabled
flag_fields = FlagFields({"Shoulder": 1, "Elbow": 2, "Wrist": 4}, selected=[])
create_target = CreateTarget(Plane=flip_plane, RobConf=flag_fields, IsCartesian=True)
create_program = CreateProgram(Name="DefaultProgram", RobotSystem=load_robot_system, Targets1=create_target, StepSize=1)  # -> Program, Code, Duration, Warnings, Errors, Arrays
value_list_2 = ValueList({"UR 10 _ Drehtisch": 0, "UR 5 _ Drehtisch": 1, "UR 5 _ Drehtisch außen": 2, "UR 5 _ Fräse": 3}, selected="UR 5 _ Fräse")
play = Button()
panel_2 = Panel(create_program.Errors)
control_knob = ControlKnob(Decimals=2, Limit=True, Maximum=1, Minimum=0, Range=1, Value=0.28)
remote_ur = RemoteUR(Program=create_program.Program, IP=c_robotpos.IpAddress, Upload=False, Play=play, Pause=False)
program_simulation = ProgramSimulation(Program=create_program.Program, Time=control_knob, Normalized=True)  # -> SystemMeshes, JointRotations, Plane, Index, Time, Program, Errors
cluster = Cluster(G=value_list_2)  # -> or_equal_to, or_equal_to_2, roboter_system, robot_ip

# ==== cluster Cluster
xz = XZPlane(Origin=Point(0, 0, 0))
G = ClusterInput()
Z = UnitZ(Factor=Slider(480, range=0..1000))
Y = UnitY(Factor=Slider(500, range=0..1000))
move = Move(Geometry=xz, Motion=Z)  # -> Geometry, Transform
xy = XYPlane(Origin=Point(0, 0, 0))
Y_2 = UnitY(Factor=1110)
list = ValueList({"ITE-UR5", "ITE-UR10"}, selected="ITE-UR5")
xy_2 = XYPlane(Origin=Point(0, 0, 0))
list_2 = ValueList({"ITE-UR5", "ITE-UR10"}, selected="ITE-UR5")
xy_3 = XYPlane(Origin=Point(0, 0, 0))
list_3 = ValueList({"ITE-UR5", "ITE-UR10"}, selected="ITE-UR10")
Y_3 = UnitY(Factor=1700)
list_4 = ValueList({"ITE-UR5", "ITE-UR10"}, selected="ITE-UR5")
move_2 = Move(Geometry=move.Geometry, Motion=Y)  # -> Geometry, Transform
move_3 = Move(Geometry=xy, Motion=Y_2)  # -> Geometry, Transform
move_4 = Move(Geometry=xy_3, Motion=Y_3)  # -> Geometry, Transform
load_robot = LoadRobotSystem(Name=list, Base=move_2.Geometry)
load_robot_2 = LoadRobotSystem(Name=list_3, Base=xy_2)
load_robot_3 = LoadRobotSystem(Name=list_2, Base=move_3.Geometry)
load_robot_4 = LoadRobotSystem(Name=list_4, Base=move_4.Geometry)
number_slider = Slider(1, range=0..10)
number_slider_2 = Slider(3, range=0..10)
filter = StreamFilter(Gate=G, Stream0=load_robot_2, Stream1=load_robot_3, Stream2=load_robot_4, Stream3=load_robot)
roboter_system = ClusterOutput(filter)
larger = LargerThan(FirstNumber=G, SecondNumber=number_slider_2)  # -> LargerThan, OrEqualTo
larger_2 = LargerThan(FirstNumber=G, SecondNumber=number_slider_2)  # -> LargerThan, OrEqualTo
or_equal_to = ClusterOutput(larger.OrEqualTo)
or_equal_to_2 = ClusterOutput(larger_2.OrEqualTo)
filter_2 = StreamFilter(Gate=larger_2.OrEqualTo, Stream0="192.168.1.202", Stream1="192.168.1.201")
robot_ip = ClusterOutput(filter_2)
