# Grasshopper definition FiberwindingExample_2.gh (Grasshopper 1.0.7)
# plug-ins: Robots, GeoGrasshopper

# ----
# WeavingPattern
number_slider = Slider(23, range=0..100)
curve = Curve(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)
curve_2 = Curve(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)
divide_curve = DivideCurve(Curve=curve_2, Count=number_slider, Kinks=False)  # -> Points, Tangents, Parameters
divide_curve_2 = DivideCurve(Curve=curve, Count=number_slider, Kinks=False)  # -> Points, Tangents, Parameters
panel = Panel("""0
0
1
1""")
panel_2 = Panel("""0
1""")
weave = Weave(Pattern=panel_2, Stream0=divide_curve.Points, Stream1=divide_curve_2.Points, NullGaps=False)
plane = Plane(weave)
point = Point(Point(202.8867313, -591.4522489, 0))
point_2 = Point(Point(683.7194242, 569.4931377, 0))

# ----
# Fiber Winder
index = Slider(100, range=0..100)
pinsize = Slider(27, range=0..100)
fiber_winder = FiberWinder(
    WeavingPlanes=plane,
    StartPoint=point,
    EndPoint=point_2,
    Index=index,
    PinSize=pinsize,
    FiberMulti=0,
    BendingMulti=Slider(0.09, range=0..1),
    BendingDistance=Slider(0.4, range=0..1),
    MarkerSize=Slider(32, range=0..1000))  # -> StreamGeometry, StreamSettings, RobotPlanes
plane_2 = Plane(fiber_winder.RobotPlanes)

# ----
# Tool Definition
endeffektor = Mesh(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)
c_gettcp = CSharpScript(mesh=endeffektor)  # -> TCP; inputs mesh: Mesh
# ---------- c_gettcp: C# ----------
    BoundingBox bBox = mesh.GetBoundingBox(false);

    TCP = new Plane(new Point3d(0,0,bBox.Max.Z), Vector3d.ZAxis);
# ---------- end c_gettcp ----------
create_tool = CreateTool(ExtruderLance="windingTool", TCP=c_gettcp, Weight=0, Mesh=endeffektor)  # -> Tool, TCP

# ----
# Table
arbeitstisch = Mesh([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])
C = ColourSwatch(SwatchColor=RGB(176, 176, 176))
custom_preview = CustomPreview(Geometry=arbeitstisch, Material=C)

# ----
# Speed
speed = Slider(3470, range=300..5000)

# ----
# Robot System
value_list = ValueList({"UR 10 Tisch": 0, "UR 5 Tisch": 1, "UR 5 Tisch außen": 2}, selected="UR 10 Tisch")
c_robotpos = CSharpScript(UR=value_list, TooltipTextOverride="Author: Leon Brohmann")  # -> Name, BasePlane, IpAddress; inputs UR: Int32
# ---------- c_robotpos: C# ----------
    string name;
    Point3d pos;
    string ipAddress;

    switch (UR)
    {
      default:
        name = "ITE-UR10";
        ipAddress = "192.168.1.201";
        pos = Point3d.Origin;
        break;

      case 1:
        name = "ITE-UR5";
        ipAddress = "192.168.1.202";
        pos = new Point3d(0, 1110, 0);
        break;

      case 2:
        name = "ITE-UR5";
        ipAddress = "192.168.1.202";
        pos = new Point3d(0, 1700, 0);
        break;
    }

    Name = name;
    BasePlane = new Plane(pos, Vector3d.ZAxis);
    IpAddress = ipAddress;
# ---------- end c_robotpos ----------
load_robot_system = LoadRobotSystem(Name=c_robotpos.Name, Base=c_robotpos.BasePlane)

# ----
# Target
value_list_2 = ValueList({"Joint", "Linear"}, selected="Linear")
flag_fields = FlagFields({"Shoulder": 1, "Elbow": 2, "Wrist": 4}, selected=[])
create_target = CreateTarget(Plane=plane_2, RobConf=flag_fields, Motion=value_list_2, Tool=create_tool.Tool, Speed=speed, IsCartesian=True)

# ----
# Preview
create_program = CreateProgram(Name="DefaultProgram", RobotSystem=load_robot_system, Targets1=create_target, StepSize=1)  # -> Program, Code, Duration, Warnings, Errors, Arrays
control_knob = ControlKnob(Decimals=3, Limit=True, Maximum=1, Minimum=0, Range=1, Value=0.331)
program_simulation = ProgramSimulation(Program=create_program.Program, Time=control_knob, Normalized=True)  # -> SystemMeshes, JointRotations, Plane, Index, Time, Program, Errors
C_2 = ColourSwatch(SwatchColor=RGB(227, 227, 227))
custom_preview_2 = CustomPreview(Geometry=program_simulation.SystemMeshes, Material=C_2)

# ----
# UR Control
play = Button()
remote_ur = RemoteUR(Program=create_program.Program, IP=c_robotpos.IpAddress, Upload=False, Play=play, Pause=False)

# ----
# Path Preview
number_slider_2 = Slider(2, range=0..10)
polyline = PolyLine(Vertices=plane_2, Closed=False)  # -> reparameterize(Polyline)
c_preview = CSharpScript(index=program_simulation.Index, simPlanes=program_simulation.Plane, pLine=polyline, width=number_slider_2)  # inputs index: Int32, simPlanes: list of Plane, pLine: Curve, width: Int32
# ---------- c_preview: C# ----------
    preview = null;
    _width = width;

    Point3d testPoint = simPlanes[7].Origin;

    double t = 0;
    pLine.ClosestPoint(testPoint, out t);

    if (t == 0)
      return;

    if (t == 1)
    {
      preview = pLine;
      return;
    }

    Curve[] crvs = pLine.Split(t);

    if (crvs == null || crvs.Length < 1)
      return;

    preview = crvs[0];
# ---------- c_preview: C# additional code ----------
  Curve preview;
  int _width;

  public override void DrawViewportMeshes(IGH_PreviewArgs args)
  {
    if (preview != null)
      args.Display.DrawCurve(preview, System.Drawing.Color.Black, _width);

  }
# ---------- end c_preview ----------
