# Grasshopper definition FiberwindingExample_Beispiel.gh (Grasshopper 1.0.7)
# plug-ins: Robots, GeoGrasshopper

# ----
# WeavingPattern Vertical
C = ColourSwatch(SwatchColor=RGB(235, 59, 123))
curve = Curve(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)
curve_2 = Curve(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)
create_material = CreateMaterial(Diffuse=C, Specular=RGB(255, 255, 255), Emission=RGB(0, 0, 0), Transparency=Slider(0.5, range=0..1), Shine=0)
loft = Loft(
    Curves=[curve, curve_2],
    Options={Adjust=False, Closed=False, LoftEnds=0, LoftSimp=0, LoftType=0, Rebuild=10, Refit=0.01})
custom_preview = CustomPreview(Geometry=loft, Material=create_material)
divide_surface = DivideSurface(Surface=loft, UCount=1, VCount=Slider(15, range=0..100))  # -> simplify(Points), Normals, Parameters
plane_normal = PlaneNormal(Origin=divide_surface.Points, ZAxis=expr("-x", divide_surface.Normals))
panel = Panel("""1
1
0
0""")
panel_2 = Panel("""0
1""")
explode_tree = ExplodeTree(Data=plane_normal)  # -> Branch0, Branch1
weave = Weave(Pattern=panel, Stream0=explode_tree.Branch0, Stream1=explode_tree.Branch1, NullGaps=False)

# ----
# WeavingPattern
number_slider = Slider(40, range=0..100)
curve_3 = Curve(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)
curve_4 = Curve(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)
divide_curve = DivideCurve(Curve=curve_3, Count=number_slider, Kinks=False)  # -> Points, Tangents, Parameters
divide_curve_2 = DivideCurve(Curve=curve_4, Count=number_slider, Kinks=False)  # -> Points, Tangents, Parameters
panel_3 = Panel("""0
0
1
1""")
panel_4 = Panel("""0
1""")
weave_2 = Weave(Pattern=panel_4, Stream0=divide_curve.Points, Stream1=divide_curve_2.Points, NullGaps=False)
plane = Plane(weave_2)

reverse_list = ReverseList(List=explode_tree.Branch0)

# ----
# Start/ Endpoints
point = Point(Point(464.6719221, -720.7696851, 335.6973495))
point_2 = Point(Point(683.7194242, 569.4931377, 0))

plane_2 = Plane(plane)
plane_3 = Plane(weave)

# ----
# Fiber Winder
alignaxis = ValueList({"None": 0, "X": 1, "Y": 2}, selected="Y")
pinsize = Slider(40, range=0..100)
index = Slider(16, range=0..100)
toolrotation = Slider(25, range=-180..180)
fiber_winder = FiberWinder(
    WeavingPlanes=plane_3,
    StartPoint=point,
    EndPoint=point_2,
    Index=index,
    PinSize=pinsize,
    FiberMulti=0,
    BendingMulti=Slider(0, range=0..1),
    BendingDistance=Slider(0.5, range=0..1),
    MarkerSize=Slider(25, range=0..1000),
    AlignAxis=alignaxis,
    ToolRotation=toolrotation)  # -> StreamGeometry, StreamSettings, RobotPlanes

# ----
# Tool Definition
# n
n = Slider(115, range=0..130)
endeffektor = Mesh(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)
c_gettcp = CSharpScript(mesh=endeffektor, n=n)  # -> TCP, MeshNozzle; inputs mesh: Mesh, n: Double
# ---------- c_gettcp: C# ----------
    BoundingBox bBox = mesh.GetBoundingBox(false);

    double height = 164 + n;

    Cylinder c = new Cylinder(new Circle(new Point3d(0, 0, 93.25), 5.25), height);
    Mesh mC = Mesh.CreateFromCylinder(c, 1, 8);

    mC.Append(mesh);

    TCP = new Plane(new Point3d(0, 0, 257.25 + n), Vector3d.ZAxis);
    MeshNozzle = mC;
# ---------- end c_gettcp ----------
create_tool = CreateTool(ExtruderLance="windingTool", TCP=c_gettcp.TCP, Weight=0, Mesh=c_gettcp.MeshNozzle)  # -> Tool, TCP

# ----
# Robot System
value_list = ValueList({"UR 10 Tisch": 0, "UR 5 Tisch": 1, "UR 5 Tisch außen": 2}, selected="UR 10 Tisch")
c_robotpos = CSharpScript(UR=value_list, TooltipTextOverride="Author: Leon Brohmann")  # -> Name, BasePlane, IpAddress; inputs UR: Int32
# ---------- c_robotpos: C# ----------
    string name;
    Point3d pos;
    string ipAddress;

    switch (UR)
    {
      default:
        name = "ITE-UR10";
        ipAddress = "192.168.1.201";
        pos = Point3d.Origin;
        break;

      case 1:
        name = "ITE-UR5";
        ipAddress = "192.168.1.202";
        pos = new Point3d(0, 1110, 0);
        break;

      case 2:
        name = "ITE-UR5";
        ipAddress = "192.168.1.202";
        pos = new Point3d(0, 1700, 0);
        break;
    }

    Name = name;
    BasePlane = new Plane(pos, Vector3d.ZAxis);
    IpAddress = ipAddress;
# ---------- end c_robotpos ----------
load_robot_system = LoadRobotSystem(Name=c_robotpos.Name, Base=c_robotpos.BasePlane)

# ----
# Table
arbeitstisch = Mesh([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])
C_2 = ColourSwatch(SwatchColor=RGB(176, 176, 176))
custom_preview_2 = CustomPreview(Geometry=arbeitstisch, Material=C_2)

# ----
# Speed
speed = Slider(3000, range=300..10000)

# ----
# Roboter Target
flag_fields = FlagFields({"Shoulder": 1, "Elbow": 2, "Wrist": 4}, selected=[])
value_list_2 = ValueList({"Joint", "Linear"}, selected="Linear")
create_target = CreateTarget(
    Plane=fiber_winder.RobotPlanes,
    RobConf=flag_fields,
    Motion=value_list_2,
    Tool=create_tool.Tool,
    Speed=speed,
    IsCartesian=True)

# ----
# Create Roboter Programm
create_program = CreateProgram(Name="DefaultProgram", RobotSystem=load_robot_system, Targets1=create_target, StepSize=1)  # -> Program, Code, Duration, Warnings, Errors, Arrays

# ----
# UR Control
play = Button()
remote_ur = RemoteUR(Program=create_program.Program, IP=c_robotpos.IpAddress, Upload=False, Play=play, Pause=False)

# ----
# Robot Preview
control_knob = ControlKnob(Decimals=3, Limit=True, Maximum=1, Minimum=0, Range=1, Value=0.258)
program_simulation = ProgramSimulation(Program=create_program.Program, Time=control_knob, Normalized=True)  # -> SystemMeshes, JointRotations, Plane, Index, Time, Program, Errors
C_3 = ColourSwatch(SwatchColor=RGB(227, 227, 227))
custom_preview_3 = CustomPreview(Geometry=program_simulation.SystemMeshes, Material=C_3)

# ----
# Roboter Path Preview
polyline = PolyLine(Vertices=fiber_winder.RobotPlanes, Closed=False)  # -> reparameterize(Polyline)
c_preview = CSharpScript(index=program_simulation.Index, simPlanes=program_simulation.Plane, pLine=polyline, width=Slider(2, range=0..10))  # inputs index: Int32, simPlanes: list of Plane, pLine: Curve, width: Int32
# ---------- c_preview: C# ----------
    preview = null;
    _width = width;

    Point3d testPoint = simPlanes[7].Origin;

    double t = 0;
    pLine.ClosestPoint(testPoint, out t);

    if (t == 0)
      return;

    if (t == 1)
    {
      preview = pLine;
      return;
    }

    Curve[] crvs = pLine.Split(t);

    if (crvs == null || crvs.Length < 1)
      return;

    preview = crvs[0];
# ---------- c_preview: C# additional code ----------
  Curve preview;
  int _width;

  public override void DrawViewportMeshes(IGH_PreviewArgs args)
  {
    if (preview != null)
      args.Display.DrawCurve(preview, System.Drawing.Color.Black, _width);

  }
# ---------- end c_preview ----------
